# Grasshopper definition pins.gh (Grasshopper 1.0.7)

number_slider = Slider(150, range=0..1000)
number_slider_2 = Slider(15, range=0..100)
number_slider_3 = Slider(28, range=0..100)
number_slider_4 = Slider(3.5, range=0..10)
number_slider_5 = Slider(31, range=0..100)
Y = UnitY(Factor=Slider(25, range=0..100))
Z = UnitZ(Factor=0)
merge = Merge(
    Data2=Slider(8, range=0..10),
    Data3=Slider(35, range=0..100),
    Data4=Slider(36, range=0..100),
    Data5=Slider(39, range=0..100),
    Data6=Slider(40, range=0..100),
    Data7=Slider(150, range=0..1000))
merge_2 = Merge(
    Data1=number_slider_2,
    Data2=Slider(18, range=0..100),
    Data3=Slider(20, range=0..100),
    Data4=Slider(20, range=0..100),
    Data5=Slider(18, range=0..100),
    Data6=Slider(10, range=0..10))
circle = CircleCNR(Center=Z, Normal=Vector(0, 0, 1), Radius=number_slider_2)
merge_3 = Merge(Data1=Slider(25, range=0..100), Data2=Slider(40, range=0..1000), Data3=Slider(25, range=0..100))
neg = Negative(Value=number_slider_4)
merge_4 = Merge(Data1=Slider(0, range=0..1), Data2=Slider(25, range=0..100), Data3=Slider(150, range=0..1000))
python = GhPythonScript(
    inner_radius=Slider(10, range=0..100),
    outer_radius=number_slider_2,
    path_width=number_slider_4,
    phase=Slider(0, range=0..1),
    direction=Toggle(False),
    resolution=Slider(100, range=0..1000),
    inwards=Toggle(False),
    height=Slider(2, range=0..10))  # -> out, pts, alfa; inputs direction: Boolean, resolution: Int32, inwards: Boolean
# ---------- python: Python ----------
from Rhino.Geometry import Point3d
from math import cos, sin

delta = 3.1415927 * 2. / resolution
path_delta = path_width / resolution

if inwards:
    r = outer_radius
else:
    r = inner_radius
    
alfa = phase

pts = []

keep_adding = True

while keep_adding:
    x = cos(alfa) * r
    y = sin(alfa) * r
    
    if inwards:
        r -= path_delta
    else:
        r += path_delta
        
    if direction:
        alfa += delta
    else:
        alfa -= delta
    
    pts.append(Point3d(x, y, height))
    
    if inwards:
        keep_adding = r > inner_radius
    else:
        keep_adding = r < outer_radius
# ---------- end python ----------
python_2 = GhPythonScript(
    inner_radius=Slider(10, range=0..100),
    outer_radius=number_slider_2,
    path_width=Slider(3.5, range=0..10),
    phase=python.alfa,
    direction=Toggle(True),
    resolution=Slider(100, range=0..1000),
    inwards=Toggle(True),
    height=Slider(5, range=0..10))  # -> out, pts, alfa; inputs direction: Boolean, resolution: Int32, inwards: Boolean; same code as python
python_3 = GhPythonScript(
    inner_radius=Slider(10, range=0..100),
    outer_radius=number_slider_2,
    path_width=Slider(3.5, range=0..10),
    phase=python_2.alfa,
    direction=Toggle(False),
    resolution=Slider(100, range=0..1000),
    inwards=Toggle(False),
    height=Slider(8, range=0..10))  # -> out, pts, alfa; inputs direction: Boolean, resolution: Int32, inwards: Boolean; same code as python
python_4 = GhPythonScript(
    height_list=merge,
    width_list=merge_2,
    phase=python_3.alfa,
    direction=Toggle(True),
    resolution=Slider(100, range=0..1000),
    layer_height=Slider(3, range=0..10))  # -> out, pts; inputs height_list: list, width_list: list, direction: Boolean, resolution: Int32
# ---------- python_4: Python ----------
from Rhino.Geometry import Point3d
from math import cos, sin

delta = 3.1415927 * 2. / resolution
h_delta = layer_height / resolution

h = height_list[0]
alfa = phase

pts = []

keep_adding = True

def radius(hs, rs, h):
    for i, h_set in enumerate(hs[1:]):
        # print(h_set, h, hs[i])
        if h < h_set and h > hs[i]:
            return rs[i] + (rs[i+1] - rs[i]) / (h_set - hs[i]) * (h - hs[i])
        elif h_set == h:
            return rs[i+1]
        elif hs[i] == h:
            return rs[i]
            
    print("don't have anything for you mate")

while keep_adding:
    r = radius(height_list, width_list, h)
    
    x = cos(alfa) * r
    y = sin(alfa) * r
    
    if direction:
        alfa += delta
    else:
        alfa -= delta
    
    pts.append(Point3d(x, y, h))
    
    h += h_delta
    
    keep_adding = h < height_list[-1]
# ---------- end python_4 ----------
Z_2 = UnitZ(Factor=merge_4)
offset = OffsetCurve(Curve=circle, Distance=neg, Plane=PlaneXY(0, 0, 0), Corners=1)
neg_2 = Negative(Value=number_slider_4)
merge_5 = Merge(Data1=python.pts, Data2=python_2.pts, Data3=python_3.pts, Data4=python_4.pts)
ln = Line(StartPoint=Z, EndPoint=Y)
circle_2 = CircleCNR(Center=Z_2, Normal=Vector(0, 0, 1), Radius=merge_3)
pline = PolyLine(Vertices=merge_5, Closed=False)
merge_6 = Merge(Data1=circle, Data2=offset)  # -> flatten(Result)
merge_7 = Merge(Data1=number_slider_4, Data2=neg_2)
panel = Panel(python_4.out)
multiplication = Multiplication(A=Slider(0.5, range=0..1), B=merge_7)
loft = Loft(Curves=circle_2, Options={Adjust=False, Closed=False, LoftEnds=0, LoftSimp=0, LoftType=3, Rebuild=10, Refit=0.01})
offset_2 = OffsetCurve(Curve=ln, Distance=multiplication, Plane=PlaneXY(0, 0, 0), Corners=1)  # -> flatten(Curve)
ccx = CurveCurve(CurveA=graft(merge_6), CurveB=offset_2)  # -> Points, ParamsA, ParamsB
path_mapper = PathMapper()
path_mapper_2 = PathMapper(ccx.ParamsA, source="{A;B;C}", target="{C}")
path_mapper_3 = PathMapper(ccx.Points, source="{A;B;C}", target="{C}")
item = ListItem(List=path_mapper_2, Index=0, Wrap=True)  # -> Item, Item1
item_2 = ListItem(List=path_mapper_3, Index=0, Wrap=True)  # -> Item, Item1
ln_2 = Line(StartPoint=item_2.Item, EndPoint=item_2.Item1)
seam = Seam(Curve=merge_6, Seam=flatten(item.Item))
